# Dynamo graph 3D views to DWG v 1.3.4.dyn (Dynamo 1.3.4.6666)

path_to_save_views = Directory("C:\Users\dbecher\Desktop\test")
get_all_views = Custom[Get All Views]()  # This node will query all views in the model and return them based on category
watch = Watch(get_all_views.3D_Views)
text_used_to_filter_views_common = StringInput("AMR_ELEC_LEVEL_")  # "Text used to Filter Views (Common ID)"
text_used_to_filter_views_level = StringInput("01")  # "Text used to Filter Views (Level ID)"
remove_whitespaces = BoolSelector(true)
filter_the_views = Python(IN[0]=watch, IN[1]=text_used_to_filter_views_common, IN[2]=text_used_to_filter_views_level, IN[3]=remove_whitespaces)
# ---------- filter_the_views.python (31 lines) ----------
import clr
clr.AddReference('ProtoGeometry')
from Autodesk.DesignScript.Geometry import *
#The inputs to this node will be stored as a list in the IN variables.
view_names = IN[0]
input = IN[1]
level = IN[2]
whitespaces = IN[3]

if whitespaces == False:
	levels = level.split(',')
else:
	clean_str = level.replace(" ", "")
	levels = clean_str.split(',')

name_list = []


for item in view_names:
	if input in str(item):
		name_list.append(item)

refined_names = []

for num in levels:
	for name in name_list:
		if num in str(name):
			refined_names.append(name)
		
#Assign your output to the OUT variable.
OUT = refined_names
# ----------------------------------------
watch_2 = Watch(filter_the_views)
export_view_name = CodeBlock(view=filter_the_views) { name = view.Name; }
watch_3 = Watch(export_view_name)
run_this_block = BoolSelector(false)
add_date = BoolSelector(false)
exports_revit_3d_view_to_dwg = Python(IN[0]=path_to_save_views, IN[1]=watch_2, IN[2]=watch_3, IN[3]=run_this_block, IN[4]=add_date)
# ---------- exports_revit_3d_view_to_dwg.python (90 lines) ----------
# Copyright(c) 2016, Konrad K Sobon
# @arch_laboratory, http://archi-lab.net

# Import Element wrapper extension methods
import clr
clr.AddReference("RevitNodes")
import Revit
clr.ImportExtensions(Revit.Elements)

# Import DocumentManager and TransactionManager
clr.AddReference("RevitServices")
import RevitServices
from RevitServices.Persistence import DocumentManager
doc = DocumentManager.Instance.CurrentDBDocument

# Import RevitAPI
clr.AddReference("RevitAPI")
import Autodesk
from Autodesk.Revit.DB import *

import time
import System
from System.Collections.Generic import *

import sys
pyt_path = r'C:\Program Files (x86)\IronPython 2.7\Lib'
sys.path.append(pyt_path)

#The inputs to this node will be stored as a list in the IN variable.
dataEnteringNode = IN

def ProcessList(_func, _list):
    return map( lambda x: ProcessList(_func, x) if type(x)==list else _func(x), _list )

def ProcessParallelLists(_func, *lists):
	return map( lambda *xs: ProcessParallelLists(_func, *xs) if all(type(x) is list for x in xs) else _func(*xs), *lists )

def Unwrap(item):
	return UnwrapElement(item)

folderPath = IN[0]

if isinstance(IN[1], list):
	views = ProcessList(Unwrap, IN[1])
else:
	views = list(Unwrap(IN[1]))

if isinstance(IN[2], list):
	names = IN[2]
else:
	names = list(IN[2])

RunIt = IN[3]
 #new Stuff
date = IN[4]

date_str = time.strftime("%Y.%m.%d")

if date == True: 
	for item in names:
		names.pop(-1)	
		item = item + '_' + date_str
		names.append(item)
#-----					
def ExportDwg(name, view, folder = folderPath):
	options = DWGExportOptions()
	options.MergedViews = True
	views = List[ElementId]()
	views.Add(view.Id)
	result = doc.Export(folder, name, views, options)
	return result

if RunIt:
	try:
		errorReport = None
		# run export
		ProcessParallelLists(ExportDwg, names, views)
		
	except:
		# if error accurs anywhere in the process catch it
		import traceback
		errorReport = traceback.format_exc()
else:
	errorReport = "Please set the RunIt to True!"

#Assign your output to the OUT variable
if errorReport == None:
	OUT = 0
else:
	OUT = errorReport
# ----------------------------------------
path_to_save_views_2 = Directory("C:\Users\dbecher\Desktop\test")
element_types = ElementTypes("View3D")
all_elements_of_type = ElementsOfType(element_types)
text_used_to_filter_views_common_2 = StringInput("AMR_ELEC_LEVEL_")  # "Text used to Filter Views (Common ID)"
text_used_to_filter_views_level_2 = StringInput("01")  # "Text used to Filter Views (Level ID)"
remove_whitespaces_2 = BoolSelector(true)
filter_the_views_2 = Python(IN[0]=all_elements_of_type, IN[1]=text_used_to_filter_views_common_2, IN[2]=text_used_to_filter_views_level_2, IN[3]=remove_whitespaces_2)  # same code as filter_the_views
watch_4 = Watch(filter_the_views_2)
export_view_name_2 = CodeBlock(view=filter_the_views_2) { name = view.Name; }
run_this_block_2 = BoolSelector(false)
add_date_2 = BoolSelector(false)
exports_revit_3d_view_to_dwg_2 = Python(IN[0]=path_to_save_views_2, IN[1]=watch_4, IN[2]=export_view_name_2, IN[3]=run_this_block_2, IN[4]=add_date_2)  # same code as exports_revit_3d_view_to_dwg
path_to_save_views_3 = Directory("C:\Users\dbecher\Desktop\test")
element_types_2 = ElementTypes("ViewPlan")
all_elements_of_type_2 = ElementsOfType(element_types_2)
text_used_to_filter_views_common_3 = StringInput("FloorPlan")  # "Text used to Filter Views (Common ID)"
text_used_to_filter_views_level_3 = StringInput("01")  # "Text used to Filter Views (Level ID)"
remove_whitespaces_3 = BoolSelector(true)
filter_the_views_3 = Python(IN[0]=all_elements_of_type_2, IN[1]=text_used_to_filter_views_common_3, IN[2]=text_used_to_filter_views_level_3, IN[3]=remove_whitespaces_3)  # same code as filter_the_views
watch_5 = Watch(filter_the_views_3)
export_view_name_3 = CodeBlock(view=filter_the_views_3) { name = view.Name; }
run_this_block_3 = BoolSelector(false)
add_date_3 = BoolSelector(false)
exports_revit_2d_view_to_dwg = Python(IN[0]=path_to_save_views_3, IN[1]=watch_5, IN[2]=export_view_name_3, IN[3]=run_this_block_3, IN[4]=add_date_3)  # same code as exports_revit_3d_view_to_dwg
path_to_save_views_4 = Directory("C:\Users\dbecher\Desktop\test")
element_types_3 = ElementTypes("ViewSheet")
all_elements_of_type_3 = ElementsOfType(element_types_3)
watch_6 = Watch(all_elements_of_type_3)
name = Parameter.Name(all_elements_of_type_3)
text_used_to_filter_views_common_4 = StringInput("LEVEL")  # "Text used to Filter Views (Common ID)"
text_used_to_filter_views_level_4 = StringInput("01A - LIGHTING")  # "Text used to Filter Views (Level ID)"
remove_whitespaces_4 = BoolSelector(false)
filter_the_views_4 = Python(IN[0]=name, IN[1]=text_used_to_filter_views_common_4, IN[2]=text_used_to_filter_views_level_4, IN[3]=remove_whitespaces_4)  # same code as filter_the_views
export_view_name_4 = CodeBlock(Sheet=filter_the_views_4) { name = Sheet; }
run_this_block_4 = BoolSelector(false)
add_date_4 = BoolSelector(false)
exports_revit_2d_view_to_dwg_2 = Python(IN[0]=path_to_save_views_4, IN[1]=watch_6, IN[2]=export_view_name_4, IN[3]=run_this_block_4, IN[4]=add_date_4)  # same code as exports_revit_3d_view_to_dwg
