# Dynamo graph export 3D views to navisworks - v1.3.4.dyn (Dynamo 1.3.4.6666)

# note: Choose folder where NWC files will be saved
directory_path = Directory("C:\")
# note: Do not use leading zeros. Use true false
# option below to add leading zeros.
start_level = StringInput("1")
end_level = StringInput("12")
range_of_level_numbers_to_export = Python(IN[0]=start_level, IN[1]=end_level)
# ---------- range_of_level_numbers_to_export.python (18 lines) ----------
#The inputs to this node will be stored as a list in the IN variables.
s_level = IN[0]
e_level = IN[1]

levels = []


for num in range(int(s_level), (int(e_level) + 1)):
	levels.append(num)
	
	
	
str_levels = str(levels).strip("[]")



#Assign your output to the OUT variable.
OUT = str_levels.replace(" ", "")
# ----------------------------------------
# note: Use ## inplace of level number.
# Level numer will replace ##.
# number of characters doesnt matter.
common_id_3d_views = StringInput("VMH2_L##_ELEC")
remove_white_spaces_from_export = BoolSelector(true)  # "Remove White Spaces from Export List"
# note: Removes all blank spaces from view
# names. Check false if names require
# blank spaces.
add_leading_zero_to_num_0_9_ex = BoolSelector(true)  # "Add leading Zero to Num 0-9 (ex. 00,01,02)"
runs_this_code_block = BoolSelector(true)
combine_levels_and_id_inot_list = Python(IN[0]=range_of_level_numbers_to_export, IN[1]=common_id_3d_views, IN[2]=remove_white_spaces_from_export, IN[3]=add_leading_zero_to_num_0_9_ex, IN[4]=runs_this_code_block)
# ---------- combine_levels_and_id_inot_list.python (34 lines) ----------
#The inputs to this node will be stored as a list in the IN variables.
str_level = IN[0]
label = IN[1]
whitespaces = IN[2]
lead_0 = IN[3]
run = IN[4]

if whitespaces == False:
	levels = str_level.split(',')
else:
	clean_str = str_level.replace(" ", "")
	levels = clean_str.split(',')

view_list = []

if run == True:
	for item in levels:
		if str.isdigit(item):
			if lead_0 ==True:
				if int(item) < 10:
					num = '0' + str(item)
					name = label.replace('##', num)
					view_list.append(name)
				else:
					num = str(item)
					name = label.replace('##', num)
					view_list.append(name)
		else:
			num = str(item)
			name = label.replace('##', num)
			view_list.append(name)
		
#Assign your output to the OUT variable.
OUT = view_list
# ----------------------------------------
add_date_to_end_of_file_name = BoolSelector(false)
export_coordinates_true_project = BoolSelector(false)  # "Export Coordinates (True=Project Internal, False = Shared)"
run_this_code_block = BoolSelector(false)
export_3d_views_to_navis_file = Python(IN[0]=directory_path, IN[1]=combine_levels_and_id_inot_list, IN[2]=add_date_to_end_of_file_name, IN[3]=export_coordinates_true_project, IN[4]=run_this_code_block)  # "Export 3D views to Navis (File Name matches View)"
# ---------- export_3d_views_to_navis_file.python (61 lines) ----------
import clr

clr.AddReference('ProtoGeometry')
from Autodesk.DesignScript.Geometry import*

clr.AddReference('RevitAPI')
import Autodesk
from Autodesk.Revit.DB import*


clr.AddReference('RevitServices')
import RevitServices
from RevitServices.Persistence import DocumentManager

import time
import System
from System.Collections.Generic import *

doc = DocumentManager.Instance.CurrentDBDocument

folder = IN[0]
name = IN[1]
date = IN[2]
int_coord = IN[3]
run = IN[4]

date_str = time.strftime("%Y%m%d")

collector = FilteredElementCollector(doc).OfClass(View)

#set export options for Navisworks
options = Autodesk.Revit.DB.NavisworksExportOptions()
options.ExportScope = NavisworksExportScope.View
options.ExportLinks = False
options.ExportRoomAsAttribute = True
options.ExportRoomGeometry = False
options.ExportUrls = False
options.DivideFileIntoLevels = False
options.ConvertElementProperties = True
options.ExportElementIds = True
options.FindMissingMaterials = True
options.Parameters = NavisworksParameters.All

if int_coord == True:
	options.Coordinates = NavisworksCoordinates.Internal
else:
	options.Coordinates = NavisworksCoordinates.Shared

#export the views
if run == True:
	for item in name:
		for view in collector:
			if (view.ViewType == ViewType.ThreeD and view.Name.Contains(item)):
				options.ViewId = view.Id
				if date == True:
					name_date = view.Name + '_' + date_str
					doc.Export(folder, name_date + ".nwc", options)
				else:
					doc.Export(folder, view.Name + ".nwc", options)

OUT = "Success"
# ----------------------------------------
level_numbers_to_export = StringInput("L3,L2,L1,1,2,11,15")  # "Level numbers to Export (separated with comma)"
